# Grasshopper definition ShrinkCellGenerator_UI.gh (Grasshopper 1.0.7)
# plug-ins: Human UI, Human, Pufferfish

slider = CreateSlider(Slider=Slider(0.4, range=0..1), ShowBounds=False, ShowTicks=False, ShowTooltip=False, ShowValLabel=True, showLabel=True)
label = CreateLabel(LabelText="Fuse width/height", LabelSize=12, Justification=0)
merge = Merge(Data1=label, Data2=slider)

slider_2 = CreateSlider(
    Slider=Slider(2, range=0..30),
    SnapValue="1",
    ShowBounds=False,
    ShowTicks=False,
    ShowTooltip=False,
    ShowValLabel=True,
    showLabel=True)
label_2 = CreateLabel(LabelText="ZigZag Count", LabelSize=12, Justification=0)
merge_2 = Merge(Data1=label_2, Data2=slider_2)

slider_3 = CreateSlider(Slider=Slider(1, range=0..5), ShowBounds=False, ShowTicks=False, ShowTooltip=False, ShowValLabel=True, showLabel=True)
label_3 = CreateLabel(LabelText="Conductive Thickness", LabelSize=12, Justification=0)
merge_3 = Merge(Data1=label_3, Data2=slider_3)

slider_4 = CreateSlider(Slider=Slider(0.5, range=0..1), ShowBounds=False, ShowTicks=False, ShowTooltip=False, ShowValLabel=True, showLabel=True)
label_4 = CreateLabel(LabelText="Double Cell Segmentation Point", LabelSize=12, Justification=0)
merge_4 = Merge(Data1=label_4, Data2=slider_4)

slider_5 = CreateSlider(Slider=Slider(2, range=1..5), ShowBounds=False, ShowTicks=False, ShowTooltip=False, ShowValLabel=True, showLabel=True)
label_5 = CreateLabel(LabelText="Number of Heater (Z)", LabelSize=12, Justification=0)
merge_5 = Merge(Data1=label_5, Data2=slider_5)

slider_6 = CreateSlider(Slider=Slider(0.36, range=0..1), ShowBounds=False, ShowTicks=False, ShowTooltip=False, ShowValLabel=True, showLabel=True)
label_6 = CreateLabel(LabelText="Nozzle Size", LabelSize=12, Justification=0)
merge_6 = Merge(Data1=label_6, Data2=slider_6)

slider_7 = CreateSlider(Slider=Slider(0.4, range=0..1), ShowBounds=False, ShowTicks=False, ShowTooltip=False, ShowValLabel=True, showLabel=True)
label_7 = CreateLabel(LabelText="SMP Thickness", LabelSize=12, Justification=0)
merge_7 = Merge(Data1=label_7, Data2=slider_7)

slider_8 = CreateSlider(Slider=Slider(5, range=2..6), ShowBounds=False, ShowTicks=False, ShowTooltip=False, ShowValLabel=True, showLabel=True)
label_8 = CreateLabel(LabelText="Power Connection Length", LabelSize=12, Justification=0)
merge_8 = Merge(Data1=label_8, Data2=slider_8)

slider_9 = CreateSlider(Slider=Slider(1, range=0..2), ShowBounds=False, ShowTicks=False, ShowTooltip=False, ShowValLabel=True, showLabel=True)
label_9 = CreateLabel(LabelText="Fuse count", LabelSize=12, Justification=0)
merge_9 = Merge(Data1=label_9, Data2=slider_9)

panel = Panel("""shrink
bendUp
bendDown""")
pulldown = CreatePulldownMenu(ListItems=panel, SelectedIndex=0)  # -> flatten(Pulldown)
pulldown_2 = CreatePulldownMenu(ListItems=panel, SelectedIndex=0)  # -> flatten(Pulldown)
label_10 = CreateLabel(LabelText="First Cell Actuation", LabelSize=12, Justification=0)
label_11 = CreateLabel(LabelText="Second Cell Actuation", LabelSize=12, Justification=0)

checkbox = CreateCheckbox(Label="double cell", StartingValue=False)
checkbox_2 = CreateCheckbox(Label="fuse control", StartingValue=False)
checkbox_3 = CreateCheckbox(Label="reverse direction", StartingValue=False)
merge_10 = Merge(Data1=checkbox, Data2=checkbox_2, Data3=checkbox_3)

merge_11 = Merge(Data1=label_10, Data2=pulldown, Data3=label_11, Data4=pulldown_2)

cmdbutton = CreateRhinoCommandButton(ButtonName="Hide cuboid", RhinoScript="Hide", ButtonStyle=0)

button = CreateButton(ButtonName="Update the ShrinkCell", ButtonStyle=0)
button_2 = CreateButton(ButtonName="Bake in to Rhino", ButtonStyle=0)
pickbtn = CreateRhinoPickButton(
    ButtonName="Select a Cell",
    Prompt="Please select geometry...",
    AllowMultiple=False,
    AllowNone=True,
    Type=0,
    ButtonStyle=0)
merge_12 = Merge(Data1=pickbtn, Data2=button, Data3=button_2, Data4=cmdbutton)

merge_13 = Merge(
    Data1=slider_3,
    Data2=slider_7,
    Data3=slider_2,
    Data4=slider_4,
    Data5=slider_6,
    Data6=slider,
    Data7=slider_9,
    Data8=slider_8,
    Data9=slider_5)
number_slider = Slider(415, range=0..450)
adjustelem = AdjustElementAppearance(
    ElementsToAdjust=merge_13,
    Foreground=ColourSwatch(SwatchColor=RGB(0, 0, 0)),
    Background=ColourSwatch(SwatchColor=RGBA(255, 255, 255, 160)))
adjustpos = AdjustElementPositioning(
    ElementsToAdjust=merge_13,
    Margin="0,0,0,20",
    AbsolutePositioning=False,
    Width=number_slider,
    Height=Slider(23, range=0..100))

merge_14 = Merge(
    Data1=label_3,
    Data2=label_7,
    Data3=label_2,
    Data4=label_4,
    Data5=label_6,
    Data6=label,
    Data7=label_9,
    Data8=label_8,
    Data9=label_5,
    Data10=label_10,
    Data11=label_11)
adjustelem_2 = AdjustElementAppearance(
    ElementsToAdjust=merge_14,
    Foreground=ColourSwatch(SwatchColor=RGB(0, 0, 0)),
    Background=ColourSwatch(SwatchColor=RGBA(255, 255, 255, 176)))
adjustpos_2 = AdjustElementPositioning(
    ElementsToAdjust=merge_14,
    Margin="0,0,0,3",
    AbsolutePositioning=False,
    Width=number_slider,
    Height=Slider(24, range=0..100))

merge_15 = Merge(Data1=merge_11, Data3=merge_12)
adjustpos_3 = AdjustElementPositioning(
    ElementsToAdjust=merge_15,
    Margin="0,0,0,3",
    AbsolutePositioning=False,
    Width=Slider(415, range=0..450),
    Height=Slider(31, range=0..100))

adjustpos_4 = AdjustElementPositioning(
    ElementsToAdjust=[merge_10, pulldown],
    Margin="0,0,0,3",
    AbsolutePositioning=False,
    Width=Slider(415, range=0..450),
    Height=Slider(20, range=0..100))

values = ValueListener(Elements=button, SomeProperty=True)  # -> Values, Indices
values_2 = ValueListener(Elements=button_2, SomeProperty=True)  # -> Values, Indices
values_3 = ValueListener(Elements=pickbtn, Trigger=values.Values, SomeProperty=True)  # -> Values, Indices
values_4 = ValueListener(Elements=pulldown, Trigger=values.Values, SomeProperty=False)  # -> Values, Indices
values_5 = ValueListener(Elements=pulldown_2, Trigger=values.Values, SomeProperty=False)  # -> Values, Indices
values_6 = ValueListener(Elements=checkbox, Trigger=values.Values, SomeProperty=False)  # -> Values, Indices
values_7 = ValueListener(Elements=checkbox_2, Trigger=values.Values, SomeProperty=False)  # -> Values, Indices
values_8 = ValueListener(Elements=checkbox_3, Trigger=values.Values, SomeProperty=False)  # -> Values, Indices
values_9 = ValueListener(Elements=slider_3, Trigger=values.Values, SomeProperty=False)  # -> Values, Indices
values_10 = ValueListener(Elements=slider_7, Trigger=values.Values, SomeProperty=False)  # -> Values, Indices
values_11 = ValueListener(Elements=slider_2, Trigger=values.Values, SomeProperty=False)  # -> Values, Indices
values_12 = ValueListener(Elements=slider_6, Trigger=values.Values, SomeProperty=False)  # -> Values, Indices
values_13 = ValueListener(Elements=slider_4, Trigger=values.Values, SomeProperty=False)  # -> Values, Indices
values_14 = ValueListener(Elements=slider, Trigger=values.Values, SomeProperty=False)  # -> Values, Indices
values_15 = ValueListener(Elements=slider_8, Trigger=values.Values, SomeProperty=False)  # -> Values, Indices
values_16 = ValueListener(Elements=slider_5, Trigger=values.Values, SomeProperty=False)  # -> Values, Indices
values_17 = ValueListener(Elements=slider_9, Trigger=values.Values, SomeProperty=False)  # -> Values, Indices

values_18 = ValueListener(Elements=cmdbutton, SomeProperty=True)  # -> Values, Indices
multiplication = Multiplication(A=values_11.Values, B=2)
getscreen = GetScreenDimensions()  # -> Width, Height
subtraction = Subtraction(A=getscreen.Height, B=Slider(220, range=0..1000))
# Cell_End_SMP_Box
# rotationAxis
launchxpwin = LaunchTransparentWindow(
    Show=Toggle(True),
    Name="ShrinkCell Generator",
    Width=Slider(450, range=0..1000),
    Height=subtraction,
    FontFamily="Arial",
    ChildStatus=0,
    EnableHorizScroll=False)
merge_16 = Merge(
    Data1=merge_3,
    Data2=merge_7,
    Data3=merge_2,
    Data4=merge_4,
    Data5=merge_6,
    Data7=merge_9,
    Data8=merge_8,
    Data9=merge_5,
    Data10=merge_10,
    Data11=merge_11,
    Data12=merge_12)

# ----
# Adjust Window Properties
accent_colors = ValueList({"Amber", "Blue", "Brown", "Cobalt", "Crimson", "Cyan", "Emerald", "Green", "Indigo", "Lime", "Magenta", "Mauve", "Olive", "Orange", "Pink", "Purple", "Red", "Sienna", "Steel", "Taupe", "Teal", "Violet", "Yellow"}, selected="Cobalt")
swatch = White(SwatchColor=RGBA(57, 68, 76, 107))
winprops = SetWindowProperties(
    Window=launchxpwin,
    Theme=Toggle(False),
    AccentColor=accent_colors,
    ShowTitleBar=Toggle(True),
    BackgroundColor=swatch,
    ScaleFactor=1)

# ----
# SMP
# Conductive
addelems = AddElements(Window=launchxpwin, Elements=flatten(merge_16), DoVLChecking=True)  # -> AddedElements, ElementNames

merge_17 = Merge(Data1=values_4.Values, Data2=values_5.Values)
panel_2 = Panel(values_4.Values)
c_script = CSharpScript(fuse=values_7.Values, doubleCell=values_6.Values, shrink=panel_2)  # -> out, frontOffset; inputs fuse: Boolean, doubleCell: Boolean, shrink: String
# ---------- c_script: C# ----------
    if(!doubleCell && !fuse && shrink == "shrink")
    {
      frontOffset = 1.5;
    }
    else
    {
      frontOffset = 0;
    }
# ---------- end c_script ----------
cell_segmentation_point = Number(values_13.Values)
doublecell = Boolean(values_6.Values)
fusemode = Boolean(values_7.Values)
celldirection = Number(values_8.Values)
conductivethickness = Number(values_9.Values)
smpthickness = Number(values_10.Values)
zigzag_arm_count = Number(multiplication)
nozzle_size = Number(values_12.Values)
brep = Brep(values_3.Values)
fuse_dimension = Number(values_14.Values)
power_body_length = Number(values_15.Values)
number_of_heater_z = Number(values_16.Values)
panel_3 = Panel(merge_17)

roundd = RoundToDecimalPlace(NumberX=conductivethickness, DecimalPlace="0.1", RoundType=0)  # -> Rounded, Difference

shrinkcellgenetaro = ShrinkCellGenetaro(
    doublecelldivision=cell_segmentation_point,
    motionmode=panel_3,
    doublecellbool=doublecell,
    cellbrep=brep,
    zigzagarmcount=zigzag_arm_count,
    celldirection=celldirection,
    fusecount=values_17.Values,
    fusewidth=fuse_dimension,
    nozzlesize=nozzle_size,
    conductivelayerthickness=roundd.Rounded,
    smpthickness=smpthickness,
    fusebool=fusemode,
    conductivelayercount=number_of_heater_z,
    powerbodylength=power_body_length,
    frontoffset=c_script.frontOffset)  # -> R, R_2, R_3
preview = CustomPreview(Geometry=[shrinkcellgenetaro.R, shrinkcellgenetaro.R_3], Material=ColourSwatch(SwatchColor=RGBA(3, 0, 255, 41)))
preview_2 = CustomPreview(Geometry=shrinkcellgenetaro.R_2, Material=ColourSwatch(SwatchColor=RGB(161, 0, 0)))

sunion = SolidUnion(Breps=flatten(shrinkcellgenetaro.R))
sunion_2 = SolidUnion(Breps=flatten(shrinkcellgenetaro.R_3))
sunion_3 = SolidUnion(Breps=flatten(shrinkcellgenetaro.R_2))
bake = BakeGeometry(Bake=values_2.Values, Geometry=[sunion_3, sunion_2, sunion], DeleteOldBakes=False, PreserveTrees=False)

# ==== cluster ShrinkCellGenetaro
cellbrep = ClusterInput()
getsrf = GetSrf(B=cellbrep)
celldirection = ClusterInput()
srf = Surface(getsrf)
celldirection_2 = Number(celldirection)
debrep = DeconstructBrep(Brep=srf)  # -> Faces, Edges, Vertices

# ----
# short edges
panel = Panel("""1
3""")
item = ListItem(List=reverse(panel), Index=celldirection_2, Wrap=True)
item_2 = ListItem(List=panel, Index=celldirection_2, Wrap=True)
item_3 = ListItem(List=debrep.Edges, Index=item, Wrap=True)
item_4 = ListItem(List=debrep.Edges, Index=item_2, Wrap=True)

# ----
# long edges
panel_2 = Panel("""0
2""")
item_5 = ListItem(List=panel_2, Index=0, Wrap=True)
item_6 = ListItem(List=debrep.Edges, Index=item_5, Wrap=True)

doublecelldivision = ClusterInput()
len = Length(Curve=item_6)
multiplication = Multiplication(A=len, DoubleCellDivision=doublecelldivision)
offset = OffsetCurve(Curve=item_4, Distance=multiplication, Corners=1)
fusebool = ClusterInput()
doublecellbool = ClusterInput()

frontline = Line(item_3)
baseline = Line(item_4)
line = Line(offset)
c_script = CSharpScript(doubleCellBool=doublecellbool, rear=baseline, inbetween=line, front=frontline)  # -> out, aSCRear, aSCFront, bSCRear, bSCFront, flatten(top_index_list); inputs doubleCellBool: Boolean, rear: Line, inbetween: Line, front: Line
# ---------- c_script: C# ----------
    if(doubleCellBool)
    {
      aSCRear = rear;
      aSCFront = inbetween;
      bSCRear = inbetween;
      bSCFront = front;
      Int32[] iLastTwo = new Int32[]{-1,-2};
      top_index_list = new List<Int32>(iLastTwo);
    }
    else
    {
      aSCRear = rear;
      aSCFront = front;
      Int32[] iLastOne = new Int32[]{-1};
      top_index_list = new List<Int32>(iLastOne);

    }
# ---------- end c_script ----------

zigzagarmcount = ClusterInput()
fusecount = ClusterInput()
fusewidth = ClusterInput()
nozzlesize = ClusterInput()
conductivelayerthickness = ClusterInput()
smpthickness = ClusterInput()
conductivelayercount = ClusterInput()
powerbodylength = ClusterInput()
frontoffset = ClusterInput()
motionmode = ClusterInput()
c_script_2 = CSharpScript(doubleCellBool=doublecellbool, motionMode=motionmode)  # -> out, mode; inputs doubleCellBool: Boolean, motionMode: list
# ---------- c_script_2: C# ----------
    if(doubleCellBool)
    {
      mode = motionMode;
    }
    else
    {
      mode = motionMode[0];
    }
# ---------- end c_script_2 ----------
cluster = Cluster_7(
    baseline_2=c_script.aSCRear,
    mode=c_script_2.mode,
    frontline_4=c_script.aSCFront,
    indexforlasttwoitems=c_script.top_index_list,
    baseline_3=c_script.bSCRear,
    length_reflineforrotation=item_6,
    frontline_5=c_script.bSCFront,
    zigzagarmcount=zigzagarmcount,
    fusecount=fusecount,
    fusewidth=fusewidth,
    fusebool=fusebool,
    nozzlesize=nozzlesize,
    conductivelayerthickness=conductivelayerthickness,
    smpthickness=smpthickness,
    conductivelayercount=conductivelayercount,
    rearline=baseline,
    frontline=frontline,
    powerbodylength=powerbodylength,
    frontoffset=frontoffset)  # -> R, R_3, R_2
R = ClusterOutput(cluster.R)
R_2 = ClusterOutput(cluster.R_3)
R_3 = ClusterOutput(cluster.R_2)
brep = Brep(cluster.R_3)

# ==== cluster GetSrf
B = ClusterInput()
debrep = DeconstructBrep(Brep=B)  # -> Faces, Edges, Vertices
area = Area(Geometry=flatten(debrep.Faces))  # -> Area, Centroid
panel = Panel("""0
1""")
sort = SortList(Keys=area.Area, ValuesA=debrep.Faces)  # -> Keys, ValuesA
item = ListItem(List=reverse(sort.ValuesA), Index=panel, Wrap=True)
area_2 = Area(Geometry=flatten(item))  # -> Area, Centroid
pdecon = Deconstruct(Point=area_2.Centroid)  # -> XComponent, YComponent, ZComponent
sort_2 = SortList(Keys=flatten(pdecon.ZComponent), ValuesA=flatten(item))  # -> Keys, ValuesA
item_2 = ListItem(List=sort_2.ValuesA, Index=0, Wrap=True)
i = ClusterOutput(item_2)

# ==== cluster Cluster_7
powerbodylength = ClusterInput()  # greater than 2
rearline = ClusterInput()
frontline = ClusterInput()
neg = Negative(Value=powerbodylength)
rearline_2 = Line(rearline)
frontline_2 = Line(frontline)
fusebool = ClusterInput()
powerbodylength_2 = Panel("-5.3")
zigzagarmcount = ClusterInput()
conductivelayercount = ClusterInput()
smpthickness = ClusterInput()
num = Number(neg)
fusewidth = ClusterInput()
fusecount = ClusterInput()
nozzlesize = ClusterInput()
conductivelayerthickness = ClusterInput()
roundf = RoundToFactor(ZigzagArmCount=zigzagarmcount, Factor="2", RoundType=expr("1", 0))  # -> Rounded, Difference, MultiplierR, MultiplierX
divisition_wall_half_width = Panel("0.5")
fusewidth_2 = Number(fusewidth)
fusebool_2 = Boolean(fusebool)
conductivelayercount_2 = Number(conductivelayercount)
fusecount_2 = Number(fusecount)
nozzlesize_2 = Number(nozzlesize)
conductivelayerthickness_2 = Number(conductivelayerthickness)
smpthickness_2 = Number(smpthickness)
conductivelayercount_3 = Number(conductivelayercount_2)
powerbodylength_3 = Number(num)
baseline = Line(rearline_2)
frontline_3 = Line(frontline_2)
conductivethickness = Number(conductivelayerthickness_2)
smpthickness_3 = Number(smpthickness_2)
baseline_2 = ClusterInput()
mode = ClusterInput()
frontline_4 = ClusterInput()
indexforlasttwoitems = ClusterInput()
baseline_3 = ClusterInput()
length_reflineforrotation = ClusterInput()
frontline_5 = ClusterInput()
frontoffset = ClusterInput()  # 1.5 recommended

offset = OffsetCurve(Curve=baseline, Distance="-2", Corners=1)
flip = FlipCurve(Curve=offset)  # -> Curve, Flag
merge = Merge(Data1=flip.Curve, Data2=frontline_3)  # -> flatten(Result)
loft = Loft(Curves=flatten(merge), Options={Adjust=False, Closed=False, LoftEnds=0, LoftSimp=0, LoftType=0, Rebuild=10, Refit=0.01})
Z = UnitZ(Factor=smpthickness_3)
extr = Extrude(Base=loft, Direction=Z)
cap = CapHoles(Brep=extr)

addition = Addition(A=conductivethickness, B=smpthickness_3)
neg_2 = Negative(Value=conductivethickness)
connectionbody = ConnectionBody(
    conductivelayerthickness=conductivethickness,
    baseline=rearline_2,
    divisionwallhalfwidth=divisition_wall_half_width,
    length=num)
series = Series(Start=neg_2, Step=addition, Count=expr("x+2", conductivelayercount_2))
Z_2 = UnitZ(Factor=series)
move = Move(Geometry=connectionbody, Motion=Z_2)  # -> Geometry, Transform

multiplication = Multiplication(A=smpthickness_3, B=conductivelayercount_2)
multiplication_2 = Multiplication(A=conductivelayerthickness_2, B=conductivelayercount_2)
addition_2 = Addition(A=multiplication_2, B=multiplication)

cluster = Cluster_4(baseline=rearline_2, smplayerheight=smpthickness_3, dividewallhalfwidth=divisition_wall_half_width, powerbodylength=num)
Z_3 = UnitZ(Factor=addition_2)
brep = Brep(cluster)
move_2 = Move(Geometry=brep, Motion=Z_3)  # -> Geometry, Transform
merge_2 = Merge(Data1=move_2.Geometry, Data2=brep)

cluster_2 = Cluster(
    frontline=frontline_3,
    frontoffset=frontoffset,
    backline=baseline,
    powerbodylength=powerbodylength_3,
    num_2=conductivethickness,
    num=smpthickness_3,
    C=conductivelayercount_3)  # -> frontline_3, R
cluster_3 = Cluster_6(
    mode=mode,
    nozzlesize_halfwidth_2=nozzlesize_2,
    zigzagarmcount_2=roundf.Rounded,
    baseline_2=baseline_2,
    fusecount_2=fusecount_2,
    frontline_2=frontline_4,
    fusebool_2=fusebool_2,
    fusedimension_2=fusewidth_2,
    powerbodylength_2=num,
    conthickness=conductivelayerthickness_2,
    conductivelayercount_2=conductivelayercount_2,
    smpthickness_3=smpthickness_3,
    smpthickness_2=smpthickness_2,
    conductivethickness_2=conductivelayerthickness_2,
    divisionwallhalfwidth_2=divisition_wall_half_width,
    conlayercount=conductivelayercount_2,
    nozzlesize_halfwidth=nozzlesize_2,
    zigzagarmcount=roundf.Rounded,
    L=indexforlasttwoitems,
    baseline=baseline_3,
    fusebool_3=fusebool_2,
    fusecount=fusecount_2,
    reflineforrotation=length_reflineforrotation,
    frontline=frontline_5,
    fusebool=fusebool_2,
    fusedimension=fusewidth_2,
    powerbodylength=num,
    conductivelayercount=conductivelayercount_2,
    smpthickness=smpthickness_2,
    conductivethickness=conductivelayerthickness_2,
    divisionwallhalfwidth=divisition_wall_half_width)  # -> G_2, zigzag_total, L_2, G, T
addition_3 = Addition(A=conductivethickness, B=smpthickness_3)

multiplication_3 = Multiplication(A=conductivethickness, B=conductivelayercount_3)
addition_4 = Addition(A=conductivelayercount_3, B=1)
multiplication_4 = Multiplication(A=smpthickness_3, B=addition_4)
addition_5 = Addition(A=multiplication_3, B=multiplication_4)

series_2 = Series(Start=0, Step=addition_3, Count=expr("x-1", conductivelayercount_3))
panel = Panel(cluster_2.R)
sunion = SolidUnion(Breps=flatten([move.Geometry, merge_2]))
Z_4 = UnitZ(Factor=series_2)
flip_2 = FlipMatrix(Data=cluster_2.R)  # -> simplify(Data)
move_3 = Move(Geometry=graft(cluster_2.R), Motion=flatten(Z_4))  # -> Geometry, Transform

cluster_4 = Cluster_3(
    powerbodylength=powerbodylength_3,
    dividingwallhalfwidth=divisition_wall_half_width,
    baseline=baseline,
    cellheight=addition_5,
    conductivelayerheight=conductivethickness)

brep_2 = Brep(cluster_3.zigzag_total)
brep_3 = Brep()
brep_4 = Brep(cluster_3.G_2)

# ----
# divider
merge_3 = Merge(Data1=cluster_3.T, Data2=cluster_3.G, Data3=cluster_3.L_2)  # -> flatten(Result)

multiplication_5 = Multiplication(A=smpthickness_3, B=conductivelayercount_2)
multiplication_6 = Multiplication(A=conductivethickness, B=conductivelayercount_2)
addition_6 = Addition(A=multiplication_6, B=multiplication_5)
panel_2 = Panel(flip_2)
c_script = CSharpScript(data=flatten(flip_2))  # -> out, conductive, SMP; inputs data: list
# ---------- c_script: C# ----------
    if(data.Count > 1)
    {
      conductive = data[0];
      SMP = data[1];
    }
    else
    {
      SMP = data[0];
    }
# ---------- end c_script ----------
Z_5 = UnitZ(Factor=addition_6)
move_4 = Move(Geometry=cap, Motion=Z_5)  # -> Geometry, Transform
bang = ExplodeTree(Data=simplify(flip_2))  # -> Branch0, Branch1

# ----
# Cell_End_SMP_Box
cluster_5 = Cluster_2(endline=frontline_3, total_sc_height=addition_5)

# ----
# top&bottom
merge_4 = Merge(Data1=cap, Data2=move_4.Geometry)

clean = CleanTree(RemoveNulls=True, RemoveInvalid=True, RemoveEmpty=False, Tree=c_script.conductive)

# ----
# top&bottom&middle
merge_5 = Merge(Data1=merge_4, Data2=c_script.SMP)

sdiff = SolidDifference(BrepsA=cluster_4, BrepsB=flatten(merge_5))  # -> flatten(Result)

# ----
# SMP Divider
merge_6 = Merge(Data1=sdiff, Data2=merge_3)  # -> flatten(Result)
sunion_2 = SolidUnion(Breps=merge_6)

# ----
# Conductive
merge_7 = Merge(Data1=sunion, Data2=brep_2, Data3=flatten(brep_4), Data4=clean)  # -> simplify(flatten(Result))

# ----
# SMP
merge_8 = Merge(Data1=cluster_5, Data2=merge_5)  # -> flatten(Result)

R = ClusterOutput(sunion_2)
sunion_3 = SolidUnion(Breps=simplify(merge_8))
sunion_4 = SolidUnion(Breps=simplify(flatten(merge_7)))
panel_3 = Panel(merge_7)
R_2 = ClusterOutput(sunion_3)
R_3 = ClusterOutput(sunion_4)

# ==== cluster Cluster
panel = Panel("0")
frontline = ClusterInput()
backline = ClusterInput()
powerbodylength = ClusterInput()
frontline_2 = Line(frontline)
frontoffset = ClusterInput()  # 1.5 recommended
frontline_3 = ClusterOutput(frontline_2)
offset = OffsetCurve(BackLine=backline, PowerBodyLength=powerbodylength, Corners=1)
num = ClusterInput()
num_2 = ClusterInput()
offset_2 = OffsetCurve(Curve=frontline_2, Distance=frontoffset, Corners=1)
num_3 = Number(num)
num_4 = Number(num_2)
flip = FlipCurve(Curve=offset)  # -> Curve, Flag
addition = Addition(A=num_4, B=num_3)
C = ClusterInput()
merge = Merge(Data1=frontline_2, Data2=offset_2)  # -> flatten(Result)
merge_2 = Merge(Data1=offset_2, Data2=flip.Curve)  # -> flatten(Result)
series = Series(Start=addition, Step=addition, Count=expr("x-1", C))
loft = Loft(Curves=flatten(merge), Options={Adjust=False, Closed=False, LoftEnds=0, LoftSimp=0, LoftType=0, Rebuild=10, Refit=0.01})
loft_2 = Loft(
    Curves=flatten(merge_2),
    Options={Adjust=False, Closed=False, LoftEnds=0, LoftSimp=0, LoftType=0, Rebuild=10, Refit=0.01})
Z = UnitZ(Factor=series)
Z_2 = UnitZ(Factor=num)
extr = Extrude(Base=loft_2, Direction=Z_2)
cap = CapHoles(Brep=extr)
extr_2 = Extrude(Base=loft, Direction=Z_2)
cap_2 = CapHoles(Brep=extr_2)
move = Move(Geometry=cap, Motion=Z)  # -> flatten(Geometry), Transform
move_2 = Move(Geometry=cap_2, Motion=Z)  # -> flatten(Geometry), Transform
c_script = CSharpScript(frontOffset=frontoffset, jointBrep=move_2.Geometry)  # -> out, joint; inputs frontOffset: Int32
# ---------- c_script: C# ----------
    if(frontOffset > 0) joint = jointBrep;
    else joint = null;
# ---------- end c_script ----------
clean = CleanTree(RemoveNulls=True, RemoveInvalid=True, RemoveEmpty=False, Tree=c_script.joint)
merge_3 = Merge(Data1=graft(clean), Data2=graft(move.Geometry))  # -> simplify(Result)
panel_2 = Panel(merge_3)
R = ClusterOutput(merge_3)

# ==== cluster Cluster_2
endline = ClusterInput()
total_sc_height = ClusterInput()

# ----
# end_side_srf_cap_with SMP
panel = Panel("-1")
offset = OffsetCurve(Curve=endline, Distance=panel, Corners=1)
end = EndPoints(Curve=endline)  # -> Start, End
end_2 = EndPoints(Curve=offset)  # -> Start, End
ln = Line(StartPoint=end_2.End, EndPoint=end.End)
ln_2 = Line(StartPoint=end_2.Start, EndPoint=end.Start)
Z = UnitZ(Factor=total_sc_height)
merge = Merge(Data1=ln_2, Data2=offset, Data3=ln, Data4=endline)  # -> flatten(Result)
join = JoinCurves(Curves=merge, Preserve=False)
extr = Extrude(Base=join, Direction=Z)
cap = CapHoles(Brep=extr)

B = ClusterOutput(cap)

# ==== cluster Cluster_3
baseline = ClusterInput()
powerbodylength = ClusterInput()
baseline_2 = Curve(baseline)
conductivelayerheight = ClusterInput()
dividingwallhalfwidth = ClusterInput()
offset = OffsetCurve(Curve=baseline_2, PowerBodyLength=powerbodylength, Corners=1)
multiplication = Multiplication(ConductiveLayerHeight=conductivelayerheight, B=2)
midpt = CurveMiddle(BaseLine=baseline_2)
cellheight = ClusterInput()
midpt_2 = CurveMiddle(Curve=offset)
ln = Line(StartPoint=midpt_2, EndPoint=midpt)
offcrv = OffsetCurve(Curve=ln, Plane=PlaneXY(0, 0, 0), DividingWallHalfWidth=dividingwallhalfwidth, BothSides=True, Kinks=0, CapType=1)
addition = Addition(CellHeight=cellheight, B=multiplication)
Z = UnitZ(Factor="-1")
move = Move(Geometry=offcrv, Motion=Z)  # -> Geometry, Transform
Z_2 = UnitZ(Factor=addition)
extr = Extrude(Base=move.Geometry, Direction=Z_2)
cap = CapHoles(Brep=extr)
fullheight = ClusterOutput(cap)

# ==== cluster ConnectionBody
divisionwallhalfwidth = ClusterInput()
baseline = ClusterInput()
len = Length(Curve=baseline)
division = Division(A=len, B=2)
subtraction = Subtraction(A=division, B=divisionwallhalfwidth)
baseline_2 = Curve(baseline)
offset = OffsetCurve(Curve=baseline_2, Distance=-2, Corners=1)
midpt = CurveMiddle(Curve=baseline_2)
end = EndPoints(Curve=baseline_2)  # -> Start, End
vec2pt = Vector2Pt(PointA=end.End, PointB=midpt, Unitize=False)  # -> Vector, Length
vec2pt_2 = Vector2Pt(PointA=end.Start, PointB=midpt, Unitize=False)  # -> Vector, Length
line = LineSDL(Start=end.End, Direction=vec2pt.Vector, Length=subtraction)
line_2 = LineSDL(Start=end.Start, Direction=vec2pt_2.Vector, Length=subtraction)
flip = FlipCurve(Curve=line)  # -> Curve, Flag
merge = Merge(Data1=line_2, Data2=flip.Curve)  # -> flatten(Result)
conductivelayerthickness = ClusterInput()
length = ClusterInput()
offcrv = OffsetCurve(Curve=merge, Plane=PlaneXY(0, 0, 0), Distance=length, BothSides=False, Kinks=0, CapType=1)
Z = UnitZ(Factor=conductivelayerthickness)
extr = Extrude(Base=offcrv, Direction=Z)
cap = CapHoles(Brep=extr)
B = ClusterOutput(cap)

# ==== cluster Cluster_4
baseline = ClusterInput()
dividewallhalfwidth = ClusterInput()
baseline_2 = Curve(baseline)
len = Length(Curve=baseline_2)
division = Division(A=len, B=2)
subtraction = Subtraction(A=division, DivideWallHalfWidth=dividewallhalfwidth)
offset = OffsetCurve(Curve=baseline_2, Distance="-2", Corners=1)
midpt = CurveMiddle(Curve=offset)
end = EndPoints(Curve=offset)  # -> Start, End
vec2pt = Vector2Pt(PointA=end.End, PointB=midpt, Unitize=False)  # -> Vector, Length
vec2pt_2 = Vector2Pt(PointA=end.Start, PointB=midpt, Unitize=False)  # -> Vector, Length
powerbodylength = ClusterInput()
line = LineSDL(Start=end.End, Direction=vec2pt.Vector, Length=subtraction)
line_2 = LineSDL(Start=end.Start, Direction=vec2pt_2.Vector, Length=subtraction)
flip = FlipCurve(Curve=line)  # -> Curve, Flag
subtraction_2 = Subtraction(PowerBodyLength=powerbodylength, B="-2")
merge = Merge(Data1=line_2, Data2=flip.Curve)  # -> flatten(Result)
smplayerheight = ClusterInput()
offcrv = OffsetCurve(Curve=merge, Plane=PlaneXY(0, 0, 0), Distance=subtraction_2, BothSides=False, Kinks=0, CapType=1)
Z = UnitZ(SMPLayerHeight=smplayerheight)
extr = Extrude(Base=offcrv, Direction=Z)
cap = CapHoles(Brep=extr)
B = ClusterOutput(cap)

# ==== cluster Cluster_6
nozzlesize_halfwidth = ClusterInput()
zigzagarmcount = ClusterInput()
baseline = ClusterInput()
fusecount = ClusterInput()
frontline = ClusterInput()
fusebool = ClusterInput()
fusedimension = ClusterInput()
powerbodylength = ClusterInput()
conductivelayercount = ClusterInput()
smpthickness = ClusterInput()
conductivethickness = ClusterInput()
divisionwallhalfwidth = ClusterInput()
nozzlesize_halfwidth_2 = ClusterInput()
zigzagarmcount_2 = ClusterInput()
baseline_2 = ClusterInput()
fusecount_2 = ClusterInput()
frontline_2 = ClusterInput()
fusebool_2 = ClusterInput()
fusedimension_2 = ClusterInput()
powerbodylength_2 = ClusterInput()
conductivelayercount_2 = ClusterInput()
smpthickness_2 = ClusterInput()
conductivethickness_2 = ClusterInput()
divisionwallhalfwidth_2 = ClusterInput()
cluster = Cluster_5(
    nozzlesize_halfwidth=nozzlesize_halfwidth_2,
    zigzagarmcount=zigzagarmcount_2,
    baseline=baseline_2,
    fusecount=fusecount_2,
    frontline=frontline_2,
    fusebool=fusebool_2,
    fusedimension=fusedimension_2,
    powerbodylength=powerbodylength_2,
    conductivelayercount=conductivelayercount_2,
    smpthickness=smpthickness_2,
    conductivethickness=conductivethickness_2,
    divisionwallhalfwidth=divisionwallhalfwidth_2)  # -> bridge, R, divider
cluster_2 = Cluster_5(
    nozzlesize_halfwidth=nozzlesize_halfwidth,
    zigzagarmcount=zigzagarmcount,
    baseline=baseline,
    fusecount=fusecount,
    frontline=frontline,
    fusebool=fusebool,
    fusedimension=fusedimension,
    powerbodylength=powerbodylength,
    conductivelayercount=conductivelayercount,
    smpthickness=smpthickness,
    conductivethickness=conductivethickness,
    divisionwallhalfwidth=divisionwallhalfwidth)  # -> bridge, R, divider
clean = CleanTree(RemoveNulls=True, RemoveInvalid=True, RemoveEmpty=False, Tree=cluster_2.bridge)
smpthickness_3 = ClusterInput()
conthickness = ClusterInput()
L = ClusterInput()
conlayercount = ClusterInput()
merge = Merge(Data1=cluster.divider, Data2=cluster_2.divider)  # -> flatten(Result)
smpthickness_4 = Number(smpthickness_3)
conthickness_2 = Number(conthickness)
merge_2 = Merge(Data1=cluster.R, Data2=cluster_2.R)  # -> flatten(Result)
cset = CreateSet(List=L)  # -> Set, Map
conlayercount_2 = Number(conlayercount)
reflineforrotation = ClusterInput()
addition = Addition(A=conthickness_2, B=smpthickness_4)

# ----
# bottom_divider
clean_2 = CleanTree(RemoveNulls=True, RemoveInvalid=True, RemoveEmpty=False, Tree=merge)

reflineforrotation_2 = Line(reflineforrotation)
midpt = CurveMiddle(Curve=reflineforrotation_2)
series = Series(Start=addition, Step=addition, Count=expr("x-1", conlayercount_2))

# ----
# bottom zigzag
clean_3 = CleanTree(RemoveNulls=True, RemoveInvalid=True, RemoveEmpty=False, Tree=merge_2)

T = ClusterOutput(clean_2)
Z = UnitZ(Factor=series)
move = Move(Geometry=clean_2, Motion=graft(Z))  # -> flatten(Geometry), Transform
move_2 = Move(Geometry=clean_3, Motion=graft(Z))  # -> flatten(Geometry), Transform
item = ListItem(List=move_2.Geometry, Index=cset.Set, Wrap=True)

# ----
# inbetween
cull_i = CullIndex(List=move.Geometry, Indices=cset.Set, Wrap=True)

item_2 = ListItem(List=move.Geometry, Index=cset.Set, Wrap=True)
area = Area(Geometry=flatten(item))  # -> Area, Centroid
merge_3 = Merge(Data1=clean_3, Data2=move_2.Geometry)

# ----
# inbetween
cull_i_2 = CullIndex(List=move_2.Geometry, Indices=cset.Set, Wrap=True)

area_2 = Area(Geometry=item_2)  # -> Area, flatten(Centroid)
item_3 = ListItem(List=area.Centroid, Index=-1, Wrap=True)
L_2 = ClusterOutput(cull_i)
fusebool_3 = ClusterInput()
item_4 = ListItem(List=merge_3, Index=Slider(0, range=0..10), Wrap=True)
item_5 = ListItem(List=area_2.Centroid, Index=-1, Wrap=True)
panel = Panel(clean)
move2pt = MoveToPoint(Geometry=reflineforrotation_2, PointA=midpt, PointB=item_3)  # -> Moved, Vector, Transform
c_script = CSharpScript(fuseMode=fusebool_3)  # -> out, angle; inputs fuseMode: Boolean
# ---------- c_script: C# ----------
    if(fuseMode)
    {
      angle = Math.PI;
    }
    else
    {
      angle = 0;
    }
# ---------- end c_script ----------
move2pt_2 = MoveToPoint(Geometry=reflineforrotation_2, PointA=midpt, PointB=item_5)  # -> Moved, Vector, Transform

# ----
# top_divider
rotax = RotateAxis(Geometry=item_2, Angle=3.141592654, Axis=move2pt_2.Moved)  # -> Geometry, Transform

# ----
# top_zigzag
rotax_2 = RotateAxis(Geometry=item, Angle=c_script.angle, Axis=move2pt.Moved)  # -> reverse(Geometry), Transform

mode = ClusterInput()
item_6 = ListItem(List=cull_i_2, Index=Slider(3, range=0..10), Wrap=True)
merge_4 = Merge(Data1=clean, Data2=cluster.bridge)  # -> flatten(Result)
series_2 = Series(Start=0, Step=addition, Count=conlayercount_2)
G = ClusterOutput(rotax.Geometry)
c_script_2 = CSharpScript(
    mode=flatten(mode),
    top_zigzag=flatten(rotax_2.Geometry),
    bottom_zigzag=flatten(clean_3),
    inbetween_zigzag=cull_i_2,
    fuseBool=fusebool_3,
    all_zigzag=merge_3)  # -> out, zigzag_total; inputs mode: list of String, top_zigzag: list of Brep, bottom_zigzag: list of Brep, inbetween_zigzag: list of Brep, fuseBool: Boolean, all_zigzag: list of Brep
# ---------- c_script_2: C# ----------
    List<Brep> zigzagSum = new List<Brep>();
    bool doubleCell = false;
    if(mode.Count > 1) doubleCell = true;

    for(int i = 0 ; i < mode.Count; i++)
    {
      if(mode[i] == "shrink" && fuseBool)
      {
        Print("shrink");
        if(top_zigzag.Count > 0) zigzagSum.Add(top_zigzag[i]);
        if(bottom_zigzag.Count > 0) zigzagSum.Add(bottom_zigzag[i]);
        if(inbetween_zigzag.Count > 0 && doubleCell)
        {
          for(int j = 0 ; j < inbetween_zigzag.Count; j++)
          {
            if(i == 0 && j % 2 == 0) zigzagSum.Add(inbetween_zigzag[j]);
            else if (i == 1 && j % 2 == 1)zigzagSum.Add(inbetween_zigzag[j]);
          }
        }
        else if (inbetween_zigzag.Count > 0 && !doubleCell)
        {
          zigzagSum.AddRange(inbetween_zigzag);
        }
        Print(zigzagSum.Count.ToString());
      }
      else if(mode[i] == "bendUp" && fuseBool)
      {
        Print("bendUp");
        if(top_zigzag.Count > 0) zigzagSum.Add(top_zigzag[i]);
        if(inbetween_zigzag.Count > 0 && inbetween_zigzag.Count % 4 == 0 && doubleCell)
        {
          for(int j = inbetween_zigzag.Count / 2 ; j < inbetween_zigzag.Count; j++)
          {
            if(i == 0 && j % 2 == 0) zigzagSum.Add(inbetween_zigzag[j]);
            else if (i == 1 && j % 2 == 1)zigzagSum.Add(inbetween_zigzag[j]);
          }
        }
        else if (inbetween_zigzag.Count > 0 && inbetween_zigzag.Count / 2 >= 1 && !doubleCell)
        {
          Print(((Int32) inbetween_zigzag.Count / 2).ToString());
          Int32 iStart = ((Int32) inbetween_zigzag.Count / 2) + 1;
          if(inbetween_zigzag.Count % 2 == 0) iStart = ((Int32) inbetween_zigzag.Count / 2);
          zigzagSum.AddRange(inbetween_zigzag.GetRange(iStart, (Int32) inbetween_zigzag.Count / 2));
          Print("bendUp for inbetween");
        }
      }
      else if(mode[i] == "bendDown" && fuseBool)
      {
        Print("bendDown");
        if(bottom_zigzag.Count > 0) zigzagSum.Add(bottom_zigzag[i]);

        if(inbetween_zigzag.Count > 0 && inbetween_zigzag.Count % 4 == 0 && doubleCell)
        {
          for(int j = 0 ; j < inbetween_zigzag.Count / 2; j++)
          {
            if(i == 0 && j % 2 == 0) zigzagSum.Add(inbetween_zigzag[j]);
            else if (i == 1 && j % 2 == 1)zigzagSum.Add(inbetween_zigzag[j]);
          }
        }
        else if (inbetween_zigzag.Count > 0 && inbetween_zigzag.Count / 2 >= 1 && !doubleCell)
        {
          Print("bendDown for inbetween");
          zigzagSum.AddRange(inbetween_zigzag.GetRange(0, (Int32) inbetween_zigzag.Count / 2));
        }
      }
    }
    if(!fuseBool)
    {
      zigzagSum.AddRange(all_zigzag);
    }
    zigzag_total = zigzagSum;
# ---------- end c_script_2 ----------
Z_2 = UnitZ(Factor=series_2)
panel_2 = Panel(mode)

# ----
# bridge
move_3 = Move(Geometry=graft(merge_4), Motion=flatten(Z_2))  # -> Geometry, Transform

zigzag_total = ClusterOutput(c_script_2.zigzag_total)
brep = Brep(c_script_2.zigzag_total)
G_2 = ClusterOutput(move_3.Geometry)

# ==== cluster Cluster_5
powerbodylength = ClusterInput()
divisionwallhalfwidth = ClusterInput()
conductivelayercount = ClusterInput()
smpthickness = ClusterInput()
conductivethickness = ClusterInput()
fusebool = ClusterInput()
fusedimension = ClusterInput()
frontline = ClusterInput()
baseline = ClusterInput()
divisionwallhalfwidth_2 = Number(divisionwallhalfwidth)
margin_between_the_divider_and_the_condu = Panel("0.25")  # "margin between the divider and the conductive ref line"
conductivelayercount_2 = Number(conductivelayercount)
smpthickness_2 = Number(smpthickness)
powerbodylength_2 = Number(powerbodylength)
conductivethickness_2 = Number(conductivethickness)
fusebool_2 = Boolean(fusebool)
fusedimension_2 = Number(fusedimension)
frontline_2 = Line(frontline)
baseline_2 = Line(baseline)
zigzagarmcount = ClusterInput()
nozzlesize_halfwidth = ClusterInput()
Z = UnitZ(Factor=smpthickness_2)
conductivelayer = ConductiveLayer(
    fuse=fusebool_2,
    baseline=baseline_2,
    line=frontline_2,
    divisionwallhalfwidth=divisionwallhalfwidth_2,
    conductivelayerheight=conductivethickness_2,
    gapbetweendividerandconductive=margin_between_the_divider_and_the_condu,
    nozzlesize_halfwidth=nozzlesize_halfwidth,
    zigzagarmcount=zigzagarmcount,
    smplayerthickness=Z)  # -> bridge, conductive, smp, zigzagstructure
fusecount = ClusterInput()
bridge = ClusterOutput(conductivelayer.bridge)
brep = Brep(conductivelayer.bridge)
fusegenerator = FuseGenerator(
    fuseheight=fusedimension_2,
    fuserefline=conductivelayer.zigzagstructure,
    fusewidth=fusedimension_2,
    baseline=baseline_2,
    frontline=frontline_2,
    fusebool=fusebool_2,
    fusecount=fusecount)
merge = Merge(Data1=fusegenerator, Data2=conductivelayer.conductive)
sdiff = SolidDifference(BrepsA=conductivelayer.smp, BrepsB=fusegenerator)
sunion = SolidUnion(Breps=flatten(merge))
c_script = CSharpScript(fuseBool=fusebool_2, fuse_divider=sdiff, no_fuse_divider=conductivelayer.smp)  # -> out, divider; inputs fuseBool: Boolean, fuse_divider: Brep, no_fuse_divider: Brep
# ---------- c_script: C# ----------
    if(fuseBool)
    {
      divider = fuse_divider;
    }
    else
    {
      divider = no_fuse_divider;
    }
# ---------- end c_script ----------
R = ClusterOutput(sunion)
divider = ClusterOutput(c_script.divider)

# ==== cluster FuseGenerator
frontline = ClusterInput()
baseline = ClusterInput()

midpt = CurveMiddle(FrontLine=frontline)
midpt_2 = CurveMiddle(BaseLine=baseline)
vec2pt = Vector2Pt(PointA=midpt_2, PointB=midpt, Unitize=False)  # -> unitize(Vector), Length

fusewidth = ClusterInput()
fuserefline = ClusterInput()
fuseheight = ClusterInput()
multiplication = Multiplication(FuseWidth=fusewidth, B=vec2pt.Vector)
fuserefline_2 = Line(fuserefline)
num = Number(fuseheight)
move = Move(Geometry=fuserefline_2, Motion=multiplication)  # -> Geometry, Transform
end = EndPoints(Curve=move.Geometry)  # -> Start, End
end_2 = EndPoints(Curve=fuserefline_2)  # -> Start, End
ln = Line(StartPoint=end_2.Start, EndPoint=end.Start)
ln_2 = Line(StartPoint=end_2.End, EndPoint=end.End)
subtraction = Subtraction(A=1, FuseHeight=num)
merge = Merge(Data1=fuserefline_2, Data2=ln, Data3=move.Geometry, Data4=ln_2)  # -> flatten(Result)
merge_2 = Merge(Data1="0", Data2=subtraction)  # -> flatten(Result)
join = JoinCurves(Curves=merge, Preserve=False)
fusecount = ClusterInput()
item = ListItem(List=merge_2, Index=Slider(1, range=0..1), Wrap=True)
Z = UnitZ(Factor=num)
extr = Extrude(Base=join, Direction=Z)
cap = CapHoles(Brep=extr)
fuse_distance = Panel("1")
series = Series(Start=0, Step=fuse_distance, FuseCount=fusecount)
Z_2 = UnitZ(Factor=item)
move_2 = Move(Geometry=cap, Motion=Z_2)  # -> Geometry, Transform
multiplication_2 = Multiplication(A=vec2pt.Vector, B=series)

# ----
# fuse
move_3 = Move(Geometry=move_2.Geometry, Motion=multiplication_2)  # -> Geometry, Transform

fusebool = ClusterInput()
c_script = CSharpScript(fuseBrep=move_3.Geometry, fuseBool=fusebool)  # -> out, result; inputs fuseBrep: Brep, fuseBool: Boolean
# ---------- c_script: C# ----------
    if(fuseBool)
    {
      result = fuseBrep;
    }
# ---------- end c_script ----------
result = ClusterOutput(c_script.result)

# ==== cluster ConductiveLayer
divisionwallhalfwidth = ClusterInput()
conductivelayerheight = ClusterInput()
line = ClusterInput()
baseline = ClusterInput()
line_2 = Line(baseline)
line_3 = Line(line)
conductivelayerheight_2 = Number(conductivelayerheight)
conductivelayerheight_3 = Number(conductivelayerheight_2)
gapbetweendividerandconductive = ClusterInput()
nozzlesize_halfwidth = ClusterInput()
zigzagarmcount = ClusterInput()
half = Panel("2")
len = Length(Curve=line_3)
division = Division(A=len, B=half)

crv = Curve(line_3)
subtraction = Subtraction(A=division, B=divisionwallhalfwidth, C=gapbetweendividerandconductive)
midpt = CurveMiddle(Curve=crv)
end = EndPoints(Curve=crv)  # -> Start, End
vec2pt = Vector2Pt(PointA=end.Start, PointB=midpt, Unitize=False)  # -> Vector, Length
vec2pt_2 = Vector2Pt(PointA=end.End, PointB=midpt, Unitize=False)  # -> Vector, Length
line_4 = LineSDL(Start=end.End, Direction=vec2pt_2.Vector, Length=subtraction)
line_5 = LineSDL(Start=end.Start, Direction=vec2pt.Vector, Length=subtraction)
flip = FlipCurve(Curve=line_4)  # -> Curve, Flag
merge = Merge(Data1=line_5, Data2=flip.Curve)  # -> flatten(Result)

midpt_2 = CurveMiddle(Curve=line_2)
midpt_3 = CurveMiddle(Curve=line_3)
vec2pt_3 = Vector2Pt(PointA=midpt_3, PointB=midpt_2, Unitize=False)  # -> unitize(Vector), Length
length_for_the_bridgeconnection = Panel("3.2")
multiplication = Multiplication(A=length_for_the_bridgeconnection, B=vec2pt_3.Vector)
move = Move(Geometry=line_3, Motion=multiplication)  # -> Geometry, Transform
fuse = ClusterInput()
c_script = CSharpScript(fuse=fuse, back_line=crv, front_line=move.Geometry, fuse_ref_line=merge)  # -> out, ref_back_line, bridge_ref_line; inputs fuse: Boolean, back_line: Line, front_line: Line, fuse_ref_line: tree of Line
# ---------- c_script: C# ----------
    if(fuse)
    {
      ref_back_line = back_line;
      bridge_ref_line = fuse_ref_line;
    }
    else
    {
      ref_back_line = front_line;
      bridge_ref_line = back_line;

    }
# ---------- end c_script ----------
divisionwallgenerator = Cluster(
    divisionwall_widt_h=divisionwallhalfwidth,
    BaseLine=line_2,
    FrontLine=c_script.ref_back_line,
    ConductiveLayerThickness=conductivelayerheight_3)  # -> Midpoint, DivisionWallRefLine, DivisionWallBrep, Midpoint_2, Vector

# ----
# plane_for_mirror
Z = UnitZ(Factor=1)
move_2 = Move(Geometry=divisionwallgenerator.Midpoint, Motion=Z)  # -> Geometry, Transform
pl_3pt = Plane3Pt(PointA=divisionwallgenerator.Midpoint, PointB=divisionwallgenerator.Midpoint_2, PointC=move_2.Geometry)

zigzagsingle = Cluster(
    DivWallRefLine=divisionwallgenerator.DivisionWallRefLine,
    AnyWidthLineofShrinkCell=line_3,
    HalfDivisionWallWidth=divisionwallhalfwidth,
    GapBetweenDividerandConductive=gapbetweendividerandconductive,
    NozzleSize_HalfWidth=nozzlesize_halfwidth,
    ZigZagArmCount=zigzagarmcount,
    BridgeFrontRefLine=move.Geometry,
    ExtrusionVector=divisionwallgenerator.Vector,
    BaseLine=line_2)  # -> Brep, FuseStartLine
mirror = Mirror(Geometry=zigzagsingle.Brep, Plane=pl_3pt)  # -> Geometry, Transform
move_3 = Move(Geometry=c_script.bridge_ref_line, Motion=multiplication)  # -> Geometry, Transform
end_2 = EndPoints(Curve=move_3.Geometry)  # -> Start, End
end_3 = EndPoints(Curve=c_script.bridge_ref_line)  # -> Start, End
ln = Line(StartPoint=end_3.End, EndPoint=end_2.End)
ln_2 = Line(StartPoint=end_3.Start, EndPoint=end_2.Start)
join = JoinCurves(Curves=flatten([c_script.bridge_ref_line, move_3.Geometry, ln_2, ln]), Preserve=False)
Z_2 = UnitZ(Factor=conductivelayerheight_2)
cls = Closed(Curve=join)  # -> Closed, Periodic
c_script_2 = CSharpScript(closed=cls.Closed, crv=join)  # -> out, closedCrv; inputs closed: Boolean, crv: Curve
# ---------- c_script_2: C# ----------
    if(closed)
    {
      closedCrv = crv;
    }
# ---------- end c_script_2 ----------
merge_2 = Merge(Data2=zigzagsingle.Brep, Data3=mirror.Geometry)  # -> flatten(Result)
extr = Extrude(Base=c_script_2.closedCrv, Direction=Z_2)
cap = CapHoles(Brep=extr)

# ----
# conductive body
merge_3 = Merge(Data1=merge_2)  # -> flatten(Result)
sunion = SolidUnion(Breps=merge_3)

brep = Brep(divisionwallgenerator.DivisionWallBrep)
# conductive layer
smplayerthickness = ClusterInput()
move_4 = Move(Geometry=brep, Motion=smplayerthickness)  # -> Geometry, Transform
move_5 = Move(Geometry=sunion, Motion=smplayerthickness)  # -> Geometry, Transform
move_6 = Move(Geometry=zigzagsingle.FuseStartLine, Motion=smplayerthickness)  # -> ZigZagStructure, Transform
move_7 = Move(Geometry=cap, Motion=smplayerthickness)  # -> Geometry, Transform
smp = ClusterOutput(move_4.Geometry)
conductive = ClusterOutput(move_5.Geometry)
bridge = ClusterOutput(move_7.Geometry)
zigzagstructure = ClusterOutput(move_6.ZigZagStructure)
